# Dynamo graph Group.dyn (Dynamo 0.9.0.3067)

fromElements = Group.FromElements()
select_model_elements = DSModelElementsSelection()  # 4 picked in the model
select_model_elements_2 = DSModelElementsSelection()  # 3 picked in the model
create = List.Create(select_model_elements, select_model_elements_2)
