# Dynamo graph Rooms.dyn (Dynamo 0.9.0.2805)

categories = Categories("Rooms")
all_elements_of_category = ElementsOfCategory(categories)
fromElement = Room.FromElement(all_elements_of_category)
doors = Room.Doors(fromElement)
