# Dynamo graph SpacesBoundaries.dyn (Dynamo 0.8.2.2392)

categories = Categories("MEPSpaces")
all_elements_of_category = ElementsOfCategory(categories)
fromElement = Space.FromElement(all_elements_of_category)
boundaryElements = Space.BoundaryElements(fromElement)
boundaryCurves = Space.BoundaryCurves(fromElement)
