# Dynamo graph SpacesFromRooms.dyn (Dynamo 0.9.0.2805)

get_documents = Custom[Get Documents]()  # Queries all linked Revit files and retrieves their Name, LinkInstance and Document properties.
integer_slider = IntegerSlider(0, range=0..100 step 1)
getItemAtIndex = List.GetItemAtIndex(list=get_documents.Link_Instance, index=integer_slider)
getItemAtIndex_2 = List.GetItemAtIndex(list=get_documents.Link_Doc, index=integer_slider)
categories = Categories("Rooms")
getFromLinkedFile = Custom[Element.GetFromLinkedFile](Link_Instance=getItemAtIndex, Link_Document=getItemAtIndex_2, Category=categories)  # Get elements from link document instance based on category
watch = Watch(getFromLinkedFile)
all_elements_of_category = ElementsOfCategory(categories)
fromElement = Room.FromElement(all_elements_of_category)
boundaryElements = Room.BoundaryElements(fromElement)
all_elements_of_category_2 = ElementsOfCategory(categories)
join = List.Join(getFromLinkedFile, all_elements_of_category_2)
fromElement_2 = Room.FromElement()
level = Room.Level(fromElement_2)
locationPoint = Room.LocationPoint()
byPoint = Space.ByPoint(locationPoint)
level_2 = Space.Level(byPoint)
locationPoint_2 = Space.LocationPoint(byPoint)
boundaryElements_2 = Space.BoundaryElements(byPoint)
categories_2 = Categories("MEPSpaces")
all_elements_of_category_3 = ElementsOfCategory(categories_2)
fromElement_3 = Space.FromElement(all_elements_of_category_3)
boundaryElements_3 = Space.BoundaryElements(fromElement_3)
